# Grasshopper definition Sample Model.gh (Grasshopper 1.0.7)

panel = Panel("C:\Users\FlorenceX\Desktop\My Desk\GOOD GOOD STUDY DAY DAY UP\GH\Etabs\#2 try\New folder\GridInfo.xlsx")

python = GhPythonScript(Path=panel, y=Toggle(True))  # -> simplify(out), a; inputs y: Boolean
# ---------- python: Python ----------
"""Provides a scripting component.
    Inputs:
        x: The x script variable
        y: The y script variable
    Output:
        a: The a output variable
             """

__author__ = "FlorenceX"
__version__ = "2020.07.29"

import rhinoscriptsyntax as rs
import xlrd
import clr
clr.AddReference("Grasshopper")
from Grasshopper.Kernel.Data import GH_Path
from Grasshopper import DataTree

dataTree = DataTree[object]()

list = []
if (y):
    loc = Path
    wb = xlrd.open_workbook(loc)
    sheet = wb.sheet_by_index(0)
    for i in range(sheet.nrows):
    
        irow= sheet.row_values(i)
        
        branch_id= i
        iirow = "".join(str(irow))
        path = GH_Path(branch_id)
        dataTree.Add(iirow,path)


a = dataTree
# ---------- end python ----------
panel_2 = Panel(python.a)

# ----
# Parse excel data
split = TextSplit(Text=python.a, Separators=",")
rep = ReplaceText(Text=split, Find="'", RecursiveReplace=False)
rep_2 = ReplaceText(Text=rep, Find="[", RecursiveReplace=False)
rep_3 = ReplaceText(Text=rep_2, Find="]", RecursiveReplace=False)

panel_3 = Panel(rep_3)

# ----
# Start and End point of Grid
item = ListItem(List=rep_3, Index=2, Wrap=True)
item_2 = ListItem(List=rep_3, Index=1, Wrap=True)
split_2 = SplitTree(Data=item_2, Masks=flatten("{0;0}"))  # -> Positive, flatten(Negative)
split_3 = SplitTree(Data=item, Masks=flatten("{0;0}"))  # -> Positive, flatten(Negative)
split_4 = TextSplit(Text=split_2.Negative, Separators="|")  # -> flatten(Result)
split_5 = TextSplit(Text=split_3.Negative, Separators="|")  # -> flatten(Result)
num2pt = NumbersToPoints(Numbers=flatten(split_4), Mask=4)
num2pt_2 = NumbersToPoints(Numbers=flatten(split_5), Mask=4)

# ----
# Label of Grids
item_3 = ListItem(List=rep_3, Index=0, Wrap=True)
split_6 = SplitTree(Data=item_3, Masks=flatten("{0;0}"))  # -> Positive, flatten(Negative)
split_7 = TextSplit(Text=split_6.Negative, Separators="|")  # -> flatten(Result)
tsort = SortText(Keys=split_7, Culture=127)  # -> Keys, Values

panel_4 = Panel(item_3)
panel_5 = Panel(split_6.Negative)

# ----
# I is the index of
#  items before sort
# sort the lines following
# the sorted points pattern
sort_pt = SortPoints(Points=num2pt_2)  # -> Points, Indices
item_4 = ListItem(List=num2pt, Index=sort_pt.Indices, Wrap=True)
ln = Line(StartPoint=sort_pt.Points, EndPoint=item_4)

# ----
# find the Grid y index
python_2 = GhPythonScript(x=tsort.Keys)  # -> out, a; inputs x: tree, y: tree
# ---------- python_2: Python ----------
__author__ = "FlorenceX"
__version__ = "2020.07.30"

import rhinoscriptsyntax as rs
import ghpythonlib.treehelpers as th
import rhinoscriptsyntax as rs
import xlrd
import clr
clr.AddReference("Grasshopper")
from Grasshopper.Kernel.Data import GH_Path
from Grasshopper import DataTree

a =[]
for path in x.Paths:

    one_list = x.Branch(path)
   
    for item in one_list:
        try:
            item =  (float(item))
        except:
            a.append (item)
            continue
# ---------- end python_2 ----------
fsim = FindSimilarMember(Data=python_2.a, Set=tsort.Keys)  # -> Hit, Index

panel_6 = Panel(sort_pt.Points)
tag = TextTag3D(Location=item_4, Text=tsort.Keys, Size=7, Justification=7)
tag_2 = TextTag3D(Location=sort_pt.Points, Text=tsort.Keys, Size=7, Justification=7)
panel_7 = Panel(python_2.a)
panel_8 = Panel(sort_pt.Indices)

# ----
# Level Elvation and Level Label
panel_9 = Panel("""288.5
489
705
887.5""")
panel_10 = Panel("""L1
L2
L3
L4""")

difference = SetDifference(SetA=sort_pt.Indices, SetB=fsim.Index)
sort = SortList(Keys=difference)  # -> Keys, ValuesA

# ----
# X
# Note: It do matter to graft X or Y!!!
# If the section is grouped by ABCD then should graft Y
# (For example, in this case!..
# Otherwise,
# you have to do a lot of path mapper to
# manipulate paths)
# Y
item_5 = ListItem(List=ln, Index=fsim.Index, Wrap=True)  # -> graft(Item)
item_6 = ListItem(List=ln, Index=sort.Keys, Wrap=True)
panel_11 = Panel(item_6)

panel_12 = Panel(item_5)
item_7 = ListItem(List=tsort.Keys, Index=sort.Keys, Wrap=True)
panel_13 = Panel(sort.Keys)
panel_14 = Panel(item_7)
ccx = CurveCurve(CurveA=item_5, CurveB=item_6)  # -> simplify(Points), ParamsA, ParamsB
division = Division(A=panel_9, B=12)

# ----
# Index for Grid in x direction
# Index for Grid in y direction
concat = Concatenate(FragmentA=graft(python_2.a), FragmentB=flatten(item_7))  # -> simplify(graft(Result))
concat_2 = Concatenate(FragmentA=graft(item_7), FragmentB=flatten(python_2.a))  # -> simplify(graft(Result))
concat_3 = Concatenate(FragmentA=concat, FragmentC="_", FragmentB=flatten(panel_10))
concat_4 = Concatenate(FragmentA=concat_2, FragmentC="_", FragmentB=flatten(panel_10))

Z = UnitZ(Factor=division)
move = Move(Geometry=ccx.Points, Motion=Z)  # -> Geometry, Transform
lng = ListLength(List=panel_10)  # -> expr("x-1", Length)
panel_15 = Panel(move.Geometry)

# ----
# Girders
list = ValueList({"One": 1, "Two": 2, "Three": 2² - 1, "Four": Sqrt(16)}, selected="Three")
list_2 = ValueList({"One": 1, "Two": 2, "Three": 2² - 1, "Four": Sqrt(16)}, selected="Two")
list_3 = ValueList({"One": 1, "Two": 2, "Three": 2² - 1, "Four": Sqrt(16)}, selected="One")
girder_in_x = GirderInX(level=list, points=move.Geometry, index=concat_3)  # -> frame_grider, girder_index
girder_in_x_2 = GirderInX(level=list_2, points=move.Geometry, index=concat_3)  # -> frame_grider, girder_index
girder_in_x_3 = GirderInX(level=list_3, points=move.Geometry, index=concat_3)  # -> frame_grider, girder_index
girder_in_y = GirderInY(level=list, points=move.Geometry, index=concat_4)  # -> frame_grider, girder_index
girder_in_y_2 = GirderInY(level=list_2, points=move.Geometry, index=concat_4)  # -> frame_grider, girder_index
girder_in_y_3 = GirderInY(level=list_3, points=move.Geometry, index=concat_4)  # -> frame_grider, girder_index

panel_16 = Panel(concat_3)
graft = GraftTree(Tree=move.Geometry, IncludeEmptyLists=True, IncludeNullItems=True)
panel_17 = Panel(girder_in_x.girder_index)
path_mapper = PathMapper(graft, source="{A;B;C}", target="{B;C}(A)")
path_mapper_2 = PathMapper(girder_in_y_2.girder_index, source="{A;B}(i)", target="{A;B;i}")
panel_18 = Panel(path_mapper)
panel_19 = Panel(girder_in_y.girder_index)

entwine = Entwine(
    Branch00=girder_in_y.girder_index,
    Branch01=girder_in_y_2.girder_index,
    Branch02=girder_in_y_3.girder_index,
    FlattenInputs=True)  # -> graft(Result)
entwine_2 = Entwine(
    Branch00=girder_in_y.frame_grider,
    Branch01=girder_in_y_2.frame_grider,
    Branch02=girder_in_y_3.frame_grider,
    FlattenInputs=True)

entwine_3 = Entwine(
    Branch00=girder_in_x.girder_index,
    Branch01=girder_in_x_2.girder_index,
    Branch02=girder_in_x_3.girder_index,
    FlattenInputs=True)  # -> graft(Result)
entwine_4 = Entwine(
    Branch00=girder_in_x.frame_grider,
    Branch01=girder_in_x_2.frame_grider,
    Branch02=girder_in_x_3.frame_grider,
    FlattenInputs=True)

end = EndPoints(Curve=entwine_4)  # -> graft(Start), graft(End)
end_2 = EndPoints(Curve=entwine_2)  # -> graft(Start), graft(End)
python_3 = GhPythonScript(x=path_mapper_2)  # -> out, d, index, a; inputs x: tree
# ---------- python_3: Python ----------
__author__ = "FlorenceX"
__version__ = "2020.08.06"

import rhinoscriptsyntax as rs
import ghpythonlib.treehelpers as th
import rhinoscriptsyntax as rs
import xlrd
import clr
clr.AddReference("Grasshopper")
from Grasshopper.Kernel.Data import GH_Path
from Grasshopper import DataTree

d = {}
index = []
i = 0
a = 0
for path in x.Paths:
    
    if path[0] == 0:
        index.append(path)
    if path[0] == 1:
        d[index[i]] = x.Branch(path)
        i = i+1
a = d.items()
# ---------- end python_3 ----------
panel_20 = Panel([entwine_3, end.Start, end.End])
panel_21 = Panel([entwine, end_2.Start, end_2.End])

# ----
# Parse data :
# Index+section+release+end points
simplify = SimplifyTree(Tree=panel_20, Front=False)
simplify_2 = SimplifyTree(Tree=panel_21, Front=False)
split_8 = TextSplit(Text=simplify, Separators="+")
split_9 = TextSplit(Text=simplify_2, Separators="+")
path_mapper_3 = PathMapper(split_9, source="{A;B;C}(i)", target="{A;B}")
path_mapper_4 = PathMapper(split_8, source="{A;B;C}(i)", target="{A;B}")

split_10 = SplitTree(Data=path_mapper, Masks=flatten("{?;0 to 2}"))  # -> Positive, Negative
split_11 = SplitTree(Data=path_mapper, Masks=flatten("{?;1 to 3}"))  # -> Positive, Negative
concat_5 = Concatenate(FragmentA="col_", FragmentB=concat_3)
panel_22 = Panel(split_10.Positive)
viewer = ParamViewer(panel_20)
path_mapper_5 = PathMapper(split_11.Positive, source="{A;B}", target="{A;B-1}")
shift = ShiftList(List=concat_5, Shift=-1, Wrap=False)  # -> simplify(List)
panel_23 = Panel(shift)
panel_24 = Panel(path_mapper_3)

# ----
# Output File Location
panel_26 = Panel("C:/Users/FlorenceX/Desktop/My Desk/GOOD GOOD STUDY DAY DAY UP/GH/Etabs/#2 try/New folder/aa.xlsx")

# ----
# B: Level
# A:A-D
# i:1-8
path_mapper_6 = PathMapper(shift, source="{A;B}(i)", target="{A;i}(B)")

panel_27 = Panel(path_mapper_6)

# ----
# Column Section by Grid ABCD
panel_28 = Panel("""W30x108
W30x99
W30x90""")
concat_6 = Concatenate(FragmentA=path_mapper_6, FragmentD="+", FragmentE=graft(panel_28), FragmentC="+", FragmentB="F|F|F|F|F|F&F|F|F|F|F|F")

# ----
# column
ln_2 = Line(StartPoint=split_10.Positive, EndPoint=split_11.Positive)

path_mapper_7 = PathMapper(ln_2, source="{A;B}(i)", target="{i;B}(A)")
end_3 = EndPoints(Curve=path_mapper_7)  # -> graft(Start), graft(End)
graft_2 = GraftTree(Tree=concat_6, IncludeEmptyLists=True, IncludeNullItems=True)
panel_29 = Panel(graft_2)
panel_30 = Panel([panel_29, end_3.Start, end_3.End])
split_12 = TextSplit(Text=panel_30, Separators="+")
path_mapper_8 = PathMapper(split_12, source="{A;B;C;D}(i)", target="{A;B;C}")

# ----
# All Frames
python_4 = GhPythonScript(j=lng, x=path_mapper_3, y=path_mapper_4, z=path_mapper_8)  # -> out, a, x; inputs x: tree, y: tree, z: tree
# ---------- python_4: Python ----------
__author__ = "FlorenceX"
__version__ = "2020.08.09"

import rhinoscriptsyntax as rs
from Grasshopper.Kernel.Data import GH_Path
from Grasshopper import DataTree
import clr
clr.AddReference("Grasshopper")

dataTree = DataTree[object]()

for path in y.Paths:
    
    a = y.Branch(path)
    # create new data branch for girder in Y
    path_new = GH_Path(path[0]+j,path[1])
    #insert items in each branch
    for i in range (5):
        x.Insert(a[i],path_new,i)
    
for path in z.Paths:
    a = z.Branch(path)
     # create new data branch for columns
    path_new = GH_Path(path[0]+j*2,path[1],path[2])
    
    #insert items in each branch
    for i in range (5):
        x.Insert(a[i],path_new,i)
# ---------- end python_4 ----------

write_to_excel = GhPythonScript(x=python_4.x, FileDestination=panel_26)  # -> out, a; inputs x: tree
# ---------- write_to_excel: Python ----------
__author__ = "FlorenceX"
__version__ = "2020.08.09"

import rhinoscriptsyntax as rs
import xlwt
import xlsxwriter
import rhinoscriptsyntax as rs
from Grasshopper.Kernel.Data import GH_Path
from Grasshopper import DataTree

#workbook = xlsxwriter.Workbook("aa.xlsx")
workbook = xlsxwriter.Workbook(FileDestination)

worksheet1 = workbook.add_worksheet()
worksheet2 = workbook.add_worksheet()

worksheet1.write(0,0, "index")
worksheet1.write(0,1,"Section")
worksheet1.write(0,2,"Release")
worksheet1.write(0,3,"StartPoint")
worksheet1.write(0,4,"EndPoint")

i = 1
for path in x.Paths:
    for j in range(5):
        a = x.Branch(path)[j]
        worksheet1.write(i,j,a)
    i = i+1


workbook.close()
# ---------- end write_to_excel ----------
panel_31 = Panel(write_to_excel.a)
panel_32 = Panel(path_mapper_8)
viewer_2 = ParamViewer(panel_32)
viewer_3 = ParamViewer(panel_32)

# ==== cluster GirderInY
index = ClusterInput()
points = ClusterInput()
level = ClusterInput()
item = ListItem(List=points, Index=level, Wrap=True)
item_2 = ListItem(List=index, Index=level, Wrap=True)
panel = Panel(item_2)
path_mapper = PathMapper(item, source="{A;B}", target="{A}(B)")
panel_2 = Panel(path_mapper)
path_mapper_2 = PathMapper(item_2, source="{A;B}", target="{A}(B)")
path_mapper_3 = PathMapper(item_2, source="{A;B}", target="{B}(A)")
tstat = TreeStatistics(Tree=path_mapper_3)  # -> Paths, Length, expr("X-1", Count)
path_mapper_4 = PathMapper(path_mapper, source="{A}(i)", target="{i}(A)")
panel_3 = Panel(path_mapper_4)
panel_4 = Panel(path_mapper_2)
panel_5 = Panel(tstat.Count)
panel_6 = Panel(path_mapper_3)
path = ConstructPath(Indices=panel_5)
lng = ListLength(List=path_mapper_4)  # -> expr("x-2", Length)
split = SplitTree(Data=path_mapper_3, Masks=path)  # -> Positive, Negative
panel_7 = Panel(split.Negative)
panel_8 = Panel(lng)
panel_9 = Panel("""W18x40
W27x84
W30x90""")
subset = SubList(List=reverse(path_mapper_4), Domain=lng, Wrap=True)  # -> reverse(List), Index
subset_2 = SubList(List=path_mapper_4, Domain=lng, Wrap=True)  # -> List, Index
panel_10 = Panel("""F|F|F|F|F|F&F|F|F|F|F|F
F|F|F|F|F|F&F|F|F|R|R|F
F|F|F|R|R|F&F|F|F|F|F|F""")
concat = Concatenate(FragmentA=split.Negative, FragmentC="+", FragmentB=graft(panel_9), FragmentD="+", FragmentE=graft(panel_10))
panel_11 = Panel(concat)
ln = Line(StartPoint=subset_2.List, EndPoint=subset.List)
panel_12 = Panel(ln)
path_mapper_5 = PathMapper(panel_11, source="{A;B}", target="{B;A}")
path_mapper_6 = PathMapper(ln, source="{A;B}(C)", target="{B;C}(A)")
item_3 = ListItem(List=panel_12, Index=0, Wrap=True)
panel_13 = Panel(path_mapper_5)
panel_14 = Panel(path_mapper_6)
frame_grider = ClusterOutput(path_mapper_6)
girder_index = ClusterOutput(panel_13)

# ==== cluster GirderInX
index = ClusterInput()
points = ClusterInput()
level = ClusterInput()
item = ListItem(List=index, Index=level, Wrap=True)  # -> graft(Item)
item_2 = ListItem(List=points, Index=level, Wrap=True)
panel = Panel(item)
path_mapper = PathMapper(item_2, source="{A;B}", target="{A}(B)")
panel_2 = Panel(path_mapper)
path_mapper_2 = PathMapper(panel, source="{A;B;C}", target="{B;C}(A)")
path_mapper_3 = PathMapper(panel, source="{A;B;C}", target="{A;C}(B)")
branch = TreeBranch(MaintainPaths=True)
panel_3 = Panel(path_mapper_3)
lng = ListLength(List=path_mapper)  # -> expr("x-2", Length)
split = SplitTree(Data=panel_3, Masks=flatten("{0;0}"))  # -> Positive, Negative
subset = SubList(List=panel_2, Domain=lng, Wrap=True)  # -> List, Index
shift = ShiftList(List=panel_3, Shift=-1, Wrap=False)
panel_4 = Panel(subset.List)
subset_2 = SubList(List=reverse(panel_2), Domain=lng, Wrap=True)  # -> List, Index
panel_5 = Panel("""F|F|F|F|F|F&F|F|F|F|F|F
F|F|F|F|F|F&F|F|F|R|R|F
F|F|F|R|R|F&F|F|F|F|F|F""")
panel_6 = Panel("""W18x40
W27x84
W30x90""")
panel_7 = Panel(shift)
concat = Concatenate(FragmentA=shift, FragmentC="+", FragmentB=graft(panel_6), FragmentD="+", FragmentE=graft(panel_5))
ln = Line(StartPoint=panel_4, EndPoint=subset_2.List)
panel_8 = Panel(concat)
path_mapper_4 = PathMapper(ln, source="{A;B;C}", target="{B;C}(A)")
panel_9 = Panel(ln)
path_mapper_5 = PathMapper(panel_8, source="{A;B}", target="{1;A-1}")
frame_grider = ClusterOutput(ln)
girder_index = ClusterOutput(concat)
